# Grasshopper definition 190906_DesignAndAssembly_yijiangh.gh (Grasshopper 1.0.7)

# ----
# 1.
# Settings
# --> Set your IP address
# --> Set robot IP address
server_address = ValueList({"192.168.10.1", "192.168.10.2", "192.168.10.3", "127.0.0.1"}, selected="192.168.10.1")
ur_ip1 = ValueList({"192.168.10.10", "192.168.10.11", "192.168.10.12", "127.0.0.1"}, selected="192.168.10.10")
server_port = Integer(30003)
globals = PythonScript(server_address=server_address, server_port=server_port, ur_ip1=ur_ip1)  # inputs server_port: Int32
# ---------- globals: Python ----------
from scriptcontext import sticky as st

st["server_address"] = server_address
st["server_port"] = server_port

st["ur_ip1"] = ur_ip1
print st["ur_ip1"]
# ---------- end globals ----------

# ----
# Check if UR is available
ping = Button()
py = PythonScript(ip=ur_ip1, ping=ping)  # -> out, trigger
# ---------- py: Python ----------
from scriptcontext import sticky as st
from ur_online_control.communication import is_available

print ip
guid = str(ghenv.Component.InstanceGuid)
txt_key = "txt_" + guid
if txt_key not in st:
    st[txt_key] = ""

if ping:
    
    available = is_available(ip)
    
    if available:
        st[txt_key] = "%s is up!" % ip
        trigger = True
    else:
        st[txt_key] = "%s is down!" % ip
        trigger = False

print st[txt_key]
# ---------- end py ----------
panel = Panel(py.out)

number_slider = Slider(1, range=0..50)  # disabled
number_slider_2 = Slider(300, range=0..1000)  # disabled
number_slider_3 = Slider(150, range=0..1000)  # disabled
d = Slider(5, range=0..100)  # disabled
number_slider_4 = Slider(30, range=0..100)  # disabled

bang = Button()
panel_2 = Panel("Unload libraries")
unload = PythonScript(bang=bang)
# ---------- unload: Python ----------
from compas_ghpython import unload_modules

unload_modules("compas")
unload_modules("ur_online_control")
unload_modules("ffw_2018")
# ---------- end unload ----------

boolean_toggle = BooleanToggle(True)  # disabled
button = Button()  # disabled
value_list = ValueList({"no_tool": 0, "measurement_tool": 1, "sand_deposition_tool": 2, "earth_deposition_tool": 3, "clay_subtraction_tool": 4, "pack_tool": 5, "arch_2019july_tool3A": 6, "arch_2019july_tool3B": 7, "vault_test2_A": 8, "vault_test2_B": 9, "vault_test2_Measure": 10}, selected="vault_test2_A")
point = Point([<point referenced from the Rhino model> x4])  # disabled
point_2 = Point(<point referenced from the Rhino model>)  # disabled
plane = Plane(Plane(origin=(523.8805311, -0.3481666342, 0), x=(-1, 0, 0), y=(0, 1, 0)))  # disabled
plane_2 = Plane(Plane(origin=(253.3121363, -293.7578269, 0), x=(0, 1, 0), y=(-1, 0, 0)))  # disabled
value_list_2 = ValueList({"robot 1": "robot_1", "robot 2": "robot_2", "robot 3": "robot_3", "archTest_robot_2", "robot_1/2", "robot_2/2", "robot_1/2_adjust", "robot_2/2_adjust"}, selected="robot_1/2_adjust")
number_slider_5 = Slider(8.6, range=0..50)

point_3 = Point([Point(150.0100578, -0.1044499903, 0), Point(71.87649037, 132.5068132, 0), Point(0.01005777432, -0.1044499903, 0), Point(64.10027216, 48.49733388, 165.8234961)])
list_item = ListItem(List=point_3, Index=Slider(0, range=0..11), Wrap=True)
ghpython_script = PythonScript(points=point_3, r=number_slider_5, run=Toggle(True), use_rpc=Toggle(True), restart_rpc_server=Toggle(False))  # -> out, pts_netw, lns_netw, pts_inv, lns_inv, o_st, b_st; inputs points: list of Point3d, use_rpc: Boolean, restart_rpc_server: Boolean
# ---------- ghpython_script: Python ----------
from compas_ghpython import unload_modules
unload_modules("coop_assembly")

if use_rpc:
    from compas.rpc import Proxy
    geo_gen_execute = Proxy('coop_assembly.geometry_generation.execute')
    if restart_rpc_server:
        geo_gen_execute.stop_server()
        geo_gen_execute.start_server()

from compas.geometry import distance_point_point
from compas_ghpython.utilities import draw_network
from compas.datastructures.network import Network
from coop_assembly.geometry_generation.main import main_gh_simple
from coop_assembly.help_functions.drawing import draw_network_inv_gh

dict_nodes = {}

for i, p in enumerate(points):
    if i > 2:
        nodes       = points[0:i]
        dists       = [distance_point_point(points[i], n) for n in nodes]
        nodes_inds  = [j for y,j in sorted(zip(dists,range(0,i)))] 
        nodes_fin = nodes_inds[0:3]
        
        dict_nodes[str(i)]= nodes_fin

points = [(p[0], p[1], p[2]) for p in points]

supports_bars = [(0,1), (1,2), (2,0)]
supports_nodes = [0, 1, 2, 4]
load_bars = [(4,5)]

load = (0,0,-2000)

if run:
    print("about to run in ghpython")
    if not use_rpc:
        # xfunc call
        b_st_data, o_st_data = main_gh_simple(points, dict_nodes, r, \
            supports_nodes, supports_bars, load_bars, load, correct=False)
    else:
        b_st_data, o_st_data = geo_gen_execute.execute_from_points(
            points, dict_nodes, r, support_nodes=supports_nodes,
            support_bars=supports_bars, load_bars=load_bars, load=load, correct=False)
    
    o_st = Network.from_data(o_st_data)
    b_st = Network.from_data(b_st_data)
    
    pts_new, lns_netw = draw_network(o_st)
    pts_inv, lns_inv, lns_conn  = draw_network_inv_gh(b_st)
# ---------- end ghpython_script ----------

number_slider_6 = Slider(4, range=0..1000)  # disabled
ghpython_script_2 = PythonScript(
    points=point,
    attractor=point_2,
    d=d,
    test=boolean_toggle,
    number_of_bars=number_slider,
    bar_len_min=number_slider_3,
    bar_len_max=number_slider_2,
    trys=number_slider_4,
    pickup_station_0=plane,
    start_end_position=plane_2)  # -> vert_endpts, vert_lns, edge_lns, fs, lines, b_struct; inputs points: list of Point3d, attractor: Point3d; disabled
# ---------- ghpython_script_2: Python ----------
from compas_ghpython import unload_modules
from compas_ghpython import utilities
from compas_ghpython.utilities import xdraw_frame
from compas_ghpython.artists.networkartist import NetworkArtist
from spatial_structures.bar_structure import Bar_Structure
from coop_assembly.geometry_generation.generate_triangles import generate_first_tetra, generate_structure_no_points
from coop_assembly.geometry_generation.fabrication_planes import generate_planes_glue
from coop_assembly.data_structure.data_structure_compas import Overall_Structure
from coop_assembly.help_functions.helpers_geometry import update_bar_lengths
from coop_assembly.help_functions.drawing import draw_network_inv_gh

import rhinoscriptsyntax as rs

        
unload_modules("coop_assembly")
        
def main():
            
    iterations = int(number_of_bars)
            
    points_compas = [(p[0],p[1],p[2]) for p in points]
    attr_compas = [attractor[0], attractor[1], attractor[2]]
            
    b_struct    = Bar_Structure()
    o_struct    = Overall_Structure(b_struct)
            
    b_struct, o_struct = generate_first_tetra(o_struct, b_struct, d/2, points_compas)
    update_bar_lengths(b_struct)
            
    b_struct = generate_structure_no_points(o_struct, b_struct, True, d/2, iterations, bar_len_min, bar_len_max, trys, attr=attr_compas)
        
            
    vert_endpts, vert_lns, edge_lns = draw_network_inv_gh(b_struct)
            
    global pickup_station_0, start_end_position
    
    pickup_station_0 = rhino_plane_to_frame(pickup_station_0)
    start_end_position = rhino_plane_to_frame(start_end_position)
            
    frames = generate_planes_glue(b_struct, d/2, pickup_station_0, iterations+5, start_end_position, start_end_position)
    print(frames)
    
#   list of three points of a frame (origin, x, y) 
    fs = []
    lines = []
    for frame in frames:
        ps = []
        for point in frame:
            p = rs.AddPoint(point)
            ps.append(p)
        fs.append(rs.PlaneFromPoints(ps[0], ps[1], ps[2]))
    for i in range(1, len(fs)):
        line = rs.AddLine(fs[i][0], fs[i-1][0])
        lines.append(line)
    return vert_endpts, vert_lns, edge_lns, fs, lines, b_struct
   
   
def rhino_plane_to_frame(plane):
# converts rhino planes to 3-pt frames
    origin = plane.Origin
    x_vec = plane.XAxis
    y_vec = plane.YAxis
    x_pt = [origin.X + x_vec.X, origin.Y + x_vec.Y, origin.Z + x_vec.Z]
    y_pt = [origin.X + y_vec.X, origin.Y + y_vec.Y, origin.Z + y_vec.Z]
    new_origin = [origin.X, origin.Y, origin.Z]
    pts = [origin, x_pt, y_pt]
    
    return pts
        
        
vert_endpts, vert_lns, edge_lns, fs, lines, b_struct = main()
# ---------- end ghpython_script_2 ----------
panel_3 = Panel(ghpython_script_2.fs)  # disabled
ghpython_script_3 = GhPythonScript()  # -> out, joint_vals
# ---------- ghpython_script_3: Python ----------
joint_vals = [[0,0,0,0,0,0], [10,10,10,10,10,10]]
# ---------- end ghpython_script_3 ----------
base = PythonScript(rnum=value_list_2)  # -> base_frame
# ---------- base: Python ----------
from compas.geometry import Frame
#from compas.geometry import Transformation, Rotation
#from compas_ghpython import xdraw_frame
#import math
#import Rhino.Geometry as rg




# for robots 1 and 2


if rnum == "robot_1":
    origin = [0.0, 0.0, 0.0]
    xaxis = [0.5, 0.0, 0.0]
    yaxis = [0.0, 0.5, 0.0]

#if rnum == "robot_1":
#    origin = [-468.74, -100.60, 161.23]
#    xaxis = [0.71376, 0.70037, 0.00520]
#    yaxis = [-0.70037, 0.71364, 0.01408]
#    

if rnum == "robot_2":
    origin = [-468.74, -100.60, 161.23]
    xaxis = [0.71376, 0.70037, 0.00520]
    yaxis = [-0.70037, 0.71364, 0.01408]


if rnum == "robot_3":
    origin = [-110.14, 465.76, 167.41]
    xaxis = [0.71228, -0.70189, -0.00042]
    yaxis = [0.70182, 0.71220, 0.01506]

if rnum == "archTest_robot_2":
    origin = [0.0, -863.6, 0.0]
#    origin = [863.6, 0.0, 0.0]
#    xaxis = [-0.5, 0, 0]
#    yaxis = [0, -0.5, 0]
    xaxis = [0.0, 0.5, 0.0]
    yaxis = [-0.5, 0.0, 0.0]
#    

if rnum == "robot_1/2":
    origin = [0.94, -433.95, 21.84]
    xaxis = [-0.01817, -0.99982, 0.00520]
    yaxis = [0.99980, -0.01813, 0.00837]

if rnum == "robot_2/2":
    origin = [-4.67, -430.58, 20.93]
    xaxis = [0.01186, 0.99984, -0.01342]
    yaxis = [-0.99993, 0.01186, -0.00009]

#if rnum == "robot_1/2_adjust":
#    # 18.4+9.057 = 27.457
#    origin = [0.0, -431.8, 27.457]
#    xaxis = [0.0, -1.0, 0.0]
#    yaxis = [1.0, 0.0, 0.0]

#============hand tune==============
if rnum == "robot_1/2_adjust":
    # 18.4+9.057 = 27.457
    origin = [0.0, -431.8, 27.457]
    xaxis = [0.0, -0.990342, -0.138648]
    yaxis = [1.0, 0.00, 0.0]


#
##----------------Robot1 FineTune Test1-----------------------
#if rnum == "robot_1/2_adjust":
#
#    origin = [2.918599, -431.57083, 24.13319]
#    xaxis = [-0.005003, -0.999956, 0.007914]
#    yaxis = [0.999987, -0.005003, 0.0]
##    
##----------------Robot1 FineTune Test_further-----------------------
#if rnum == "robot_1/2_adjust":
#
#    origin = [2, -431.57083, 24.13319]
#    xaxis = [-0.005003, -0.999956, 0.0]
#    yaxis = [0.999987, -0.005003, 0.0]

#if rnum == "robot_1/2_adjust":
#    # 18.4+9.057 = 27.457
#    #origin = [0.0, -431.8, 27.457]
#    origin = [(0.0+3.29), (-431.8+0.305), (27.457+3.16)]
#    xaxis = [0.004308, -0.999955, -0.008393]
#    yaxis = [0.995332, 0.005097, -0.096381]

#if rnum == "robot_1/2_adjust":
#    # 18.4+9.057 = 27.457
#    #origin = [0.0, -431.8, 27.457]
#    origin = [(0.0+3.29), (-431.8+0.305), (27.457+3.16)]
#    xaxis = [0.004308, -0.999955, -0.008393]
#    yaxis = [0.995332, 0.005097, 0.0]

#if rnum == "robot_1/2_adjust":
#    # 18.4+9.057 = 27.457
#    #origin = [0.0, -431.8, 27.457]
#    origin = [(0.0+3.29), (-431.8+0.305), (27.457+3.16)]
#    xaxis = [0.0-0.007668, -1.0-0.008534, 0.0-0.004074]
    yaxis = [1.0+0.008967, 0.0-0.001773, 0.0-0.010964]

if rnum == "robot_2/2_adjust":
    origin = [0.0, -431.8, 27.457]
    xaxis = [0.0, 1.0, 0.0]
    yaxis = [-1.0, 0.0, 0.0]

base_frame = Frame(list(origin), list(xaxis), list(yaxis))
print base_frame
# ---------- end base ----------
plane_3 = Plane()
# Here, you can set the basis for your robot
base_2 = PythonScript(rnum=value_list_2)  # -> base_frame
# ---------- base_2: Python ----------
from compas.geometry import Frame
#from compas.geometry import Transformation, Rotation
#from compas_ghpython import xdraw_frame
#import math
#import Rhino.Geometry as rg




# for robots 1 and 2


if rnum == "robot_1":
    origin = [0.0, 0.0, 0.0]
    xaxis = [0.5, 0.0, 0.0]
    yaxis = [0.0, 0.5, 0.0]

#if rnum == "robot_1":
#    origin = [-468.74, -100.60, 161.23]
#    xaxis = [0.71376, 0.70037, 0.00520]
#    yaxis = [-0.70037, 0.71364, 0.01408]
#    

if rnum == "robot_2":
    origin = [-468.74, -100.60, 161.23]
    xaxis = [0.71376, 0.70037, 0.00520]
    yaxis = [-0.70037, 0.71364, 0.01408]


if rnum == "robot_3":
    origin = [-110.14, 465.76, 167.41]
    xaxis = [0.71228, -0.70189, -0.00042]
    yaxis = [0.70182, 0.71220, 0.01506]

if rnum == "archTest_robot_2":
    origin = [0.0, -863.6, 0.0]
#    origin = [863.6, 0.0, 0.0]
#    xaxis = [-0.5, 0, 0]
#    yaxis = [0, -0.5, 0]
    xaxis = [0.0, 0.5, 0.0]
    yaxis = [-0.5, 0.0, 0.0]
#    

if rnum == "robot_1/2":
    origin = [0.94, -433.95, 21.84]
    xaxis = [-0.01817, -0.99982, 0.00520]
    yaxis = [0.99980, -0.01813, 0.00837]

if rnum == "robot_2/2":
    origin = [-4.67, -430.58, 20.93]
    xaxis = [0.01186, 0.99984, -0.01342]
    yaxis = [-0.99993, 0.01186, -0.00009]

if rnum == "robot_1/2_adjust":
    # 18.4+9.057 = 27.457
    origin = [3.0, -431.8, 26]
    xaxis = [0.0, -1.0, 0.0]
    yaxis = [1.0, 0.0, 0.0]
#    
#===========further away
#if rnum == "robot_1/2_adjust":
#    # 18.4+9.057 = 27.457
#    origin = [1.0, -445, 26]
#    xaxis = [0.0, -1.0, 0.0]
#    yaxis = [1.0, 0.0, 0.0]

if rnum == "robot_2/2_adjust":
    origin = [0.0, -431.8, 27.457]
    xaxis = [0.0, 1.0, 0.0]
    yaxis = [-1.0, 0.0, 0.0]

base_frame = Frame(list(origin), list(xaxis), list(yaxis))
print base_frame
# ---------- end base_2 ----------
tools = Tools(tool_id=value_list)

# ---- group: Robot1
# 1. load robot model
# 2. set tool
# 3. set basis
value_list_3 = ValueList({"UR3", "UR5", "UR10"}, selected="UR3")
robot = PythonScript(model=value_list_3)  # -> robot1
# ---------- robot: Python ----------
from ur_online_control.ur.ur10 import UR10
from ur_online_control.ur.ur5 import UR5
from ur_online_control.ur.ur3 import UR3
from scriptcontext import sticky as st

if model == "UR5":
    robot1 = UR5()
elif model == "UR10":
    robot1 = UR10()
elif model == "UR3":
    robot1 = UR3()
# ---------- end robot ----------
set_params = PythonScript(robot1=robot, tool=tools, base_frame=base_2)  # -> robot1
# ---------- set_params: Python ----------
from ur_online_control.ur.ur10 import UR10
from ur_online_control.ur.ur5 import UR5
from scriptcontext import sticky as st
from ur_online_control.ur.tool import Tool
from compas.geometry import Frame


if tool:
    robot1.set_tool(tool)
else:
    robot1.set_tool(Tool(Frame.worldXY()))  
if base_frame:
    robot1.set_base(base_frame)

st["robot1"] = robot1
# ---------- end set_params ----------

# ----
list_item_2 = ListItem(List=panel_3, Index=number_slider_6, Wrap=True)  # disabled
line = Line(ghpython_script_2.lines)  # disabled
panel_4 = Panel(ghpython_script.out)
division = Division(A=d, B=2)  # disabled
number_slider_7 = Slider(8, range=0..10)  # disabled
panel_5 = Panel(list_item_2)  # disabled
plane_4 = Plane(ghpython_script_2.fs)  # disabled
pipe = Pipe(Curve=ghpython_script_2.vert_lns, Radius=division, Caps=0)  # -> flatten(Pipe); disabled
ghpython_script_4 = GhPythonScript(b_struct=ghpython_script_2.b_struct)  # -> out, planes, planes_all; disabled
# ---------- ghpython_script_4: Python ----------
import Rhino.Geometry as rg

planes = []
for v in b_struct.vertex:
    gp = b_struct.vertex[v]["gripping_plane"]
    pl = rg.Plane(rg.Point3d(gp[0][0], gp[0][1],gp[0][2]), rg.Point3d(gp[1][0], gp[1][1],gp[1][2]), rg.Point3d(gp[2][0], gp[2][1],gp[2][2]))
    planes.append(pl)

planes_all = []
for i,v in enumerate(b_struct.vertex):
    gp_all = b_struct.vertex[v]["gripping_planes_all"]
    planes_all.append([])
    for gp in gp_all:
        pl = rg.Plane(rg.Point3d(gp[0][0], gp[0][1],gp[0][2]), rg.Point3d(gp[1][0], gp[1][1],gp[1][2]), rg.Point3d(gp[2][0], gp[2][1],gp[2][2]))
        planes_all[i].append(pl)
# ---------- end ghpython_script_4 ----------
number_slider_8 = Slider(3, range=0..50)

# ---- group: gripping plane generation
ghpython_script_5 = GhPythonScript(b_struct=ghpython_script.b_st, nb_rot=Slider(8, range=2..50), nb_trans=Slider(9, range=2..50), flip=Toggle(True))  # -> out, planes, planes_out; inputs nb_rot: Int32, nb_trans: Int32, flip: Boolean
# ---------- ghpython_script_5: Python ----------
import Rhino.Geometry as rg
from ghpythonlib.treehelpers import list_to_tree

from coop_assembly.assembly_info_generation.fabrication_planes import calculate_gripping_plane

for v in b_struct.vertex:
    calculate_gripping_plane(b_struct, v, b_struct.vertex[v]["mean_point"], nb_rot=nb_rot, nb_trans=nb_trans, planes_flip=flip)

planes = []
for v in b_struct.vertex:
    gp = b_struct.vertex[v]["gripping_plane"]
    pl = rg.Plane(rg.Point3d(gp[0][0], gp[0][1],gp[0][2]), rg.Vector3d(gp[1][0], gp[1][1],gp[1][2]), rg.Vector3d(gp[2][0], gp[2][1],gp[2][2]))
    planes.append(pl)

planes_all = []
for i,v in enumerate(b_struct.vertex):
    gp_all = b_struct.vertex[v]["gripping_planes_all"]
    planes_all.append([])
    for gp in gp_all:
        pl = rg.Plane(rg.Point3d(gp[0][0], gp[0][1],gp[0][2]), rg.Vector3d(gp[1][0], gp[1][1],gp[1][2]), rg.Vector3d(gp[2][0], gp[2][1],gp[2][2]))
        planes_all[i].append(pl)

planes_out = list_to_tree(planes_all)
# ---------- end ghpython_script_5 ----------
plane_5 = Plane(ghpython_script_5.planes_out)
list_item_3 = ListItem(List=ghpython_script_5.planes, Index=number_slider_8, Wrap=True)
list_item_4 = ListItem(List=ghpython_script_5.planes_out, Index=0, Wrap=True)
custom_preview = CustomPreview(
    Geometry=list_item_3,
    Material={diffuse=RGB(221, 160, 221), emission=RGB(66, 48, 66), shine=0.5, specular=RGB(255, 255, 255), transparency=0})

# ----
pipe_2 = Pipe(Curve=ghpython_script.lns_inv, Radius=number_slider_5, Caps=0)
list_item_5 = ListItem(List=ghpython_script_4.planes_all, Index=0, Wrap=True)  # disabled
line_2 = Line(ghpython_script.lns_inv)
line_3 = Line(ghpython_script.lns_netw)

# ---- group: for touble shooting
# 4.
# Fabrication process example #1 (MoveL)
# The planes, speed-values, acceleration-values, and wait-time-values that are sent to the robot
acceleration = Slider(60, range=0..100)
plane_generation = GhPythonScript(
    frames_WCS=plane_3,
    joint_vals=ghpython_script_3.joint_vals,
    speed=Slider(100, range=0..100),
    acceleration=acceleration,
    wait_time=Slider(2, range=0..10))  # -> out, frames_WCS, speed_values, acceleration_values, wait_time_values; inputs frames_WCS: list, joint_vals: list
# ---------- plane_generation: Python ----------
import Rhino.Geometry as rg
import ghpythonlib.components as ghcomp
from compas.geometry import Frame
from compas.geometry import Transformation
from compas_ghpython import xdraw_frame
import math


#plane_WCS = rg.Plane.WorldXY
#plane_WCS.Rotate(math.radians(180), plane_WCS.XAxis, plane_WCS.Origin)
#
#div_pts, tangents, parmas = ghcomp.DivideCurve(crv, div_num, False)
#planes_WCS = [rg.Plane(pt, plane_WCS.XAxis, plane_WCS.YAxis) for pt in div_pts]

print frames_WCS
speed_values = []
acceleration_values = []
wait_time_values = []

for i, p in enumerate(frames_WCS):
    if i%2==0:
        speed_values.append(speed)
        acceleration_values.append(acceleration)
        wait_time_values.append(wait_time)
    else:
        speed_values.append(speed)
        acceleration_values.append(acceleration)
        wait_time_values.append(wait_time*2)
# ---------- end plane_generation ----------
command_gen = PythonScript(
    frames_WCS=plane_generation.frames_WCS,
    speed_values=plane_generation.speed_values,
    acceleration_values=plane_generation.acceleration_values,
    wait_time_values=plane_generation.wait_time_values)  # -> out, commands; inputs frames_WCS: list, safety_planes_WCS: list of Plane, speed_values: list, acceleration_values: list, wait_time_values: list
# ---------- command_gen: Python ----------
import os
import Rhino.Geometry as rg
from scriptcontext import sticky as st
from ur_online_control.communication.msg_identifiers import *
from ur_online_control.utilities.lists import flatten_list
from compas.geometry import Frame, Transformation
from compas_ghpython import xdraw_frame
import json

robot1 = st["robot1"]
tool = robot1.tool
tool_pose = list(tool.tcp_frame.point) + tool.tcp_frame.axis_angle_vector

#format planes into commands
commands = []
for i, frame_WCS in enumerate(frames_WCS):
    tcp_WCS = Frame(frame_WCS[0], frame_WCS[1], frame_WCS[2])
    pose = robot1.get_pose_angle_axis_in_RCS(tcp_WCS) #tcp_RCS = robot1.get_frame_in_RCS(tcp_WCS) #pose = list(tcp_RCS.point) + tcp_RCS.axis_angle_vector
    print pose
    speed = speed_values[i]
    acceleration = acceleration_values[i]
    wait_time_value = wait_time_values[i]
    cmd = pose + [acceleration, speed, wait_time_value]
    commands.append(cmd)
# ---------- end command_gen ----------

# ----
list_item_6 = ListItem(List=pipe, Index=number_slider_7, Wrap=True)  # disabled
list_item_7 = ListItem(List=ghpython_script_4.planes, Index=number_slider_7, Wrap=True)  # disabled
panel_6 = Panel(ghpython_script_5.out)
custom_preview_2 = CustomPreview(
    Geometry=list_item_6,
    Material={diffuse=RGB(221, 160, 221), emission=RGB(66, 48, 66), shine=0.5, specular=RGB(255, 255, 255), transparency=0})  # disabled
custom_preview_3 = CustomPreview(Geometry=pipe_2, Shader=ColourSwatch(SwatchColor=RGBA(61, 200, 255, 168)))

# ----
# 3.
# UR online control
# If the connection is lost, please restart the connection here.
# Press here to send the commands
# to the robot
start = Button()

custom_preview_4 = CustomPreview(
    Geometry=list_item_7,
    Material={diffuse=RGB(221, 160, 221), emission=RGB(66, 48, 66), shine=0.5, specular=RGB(255, 255, 255), transparency=0})  # disabled
point_4 = Point(ghpython_script.pts_netw)
list_item_8 = ListItem(List=line_2, Index=number_slider_8, Wrap=True)
# Checklist before sending a program to the robot:
# 
# 1. correct IP address and ping tested
# 2. correct tool
# 3. correct main file
# 4. correct example chosen
# 
# if your visualisation is showing something unexpected, check if you have chosen the right option fro the dropdown menu.
panel_7 = Panel("main_robot.py")

panel_8 = Panel("Start communication server")
py_2 = PythonScript()  # -> path
# ---------- py_2: Python ----------
import sys
import os
from scriptcontext import sticky as st

ghComp = ghenv.Component
ghDoc = ghComp.OnPingDocument()

# the full path of the gh file
path = ghDoc.FilePath
# the directory of the gh file
path = os.path.dirname(path)
st["path"] = path

json_path = os.path.abspath(os.path.join(path, "..", "tmp"))
#path = os.path.abspath(os.path.join(path, "..", "Test01_Arch"))


st["json_path"] = json_path 

print path
print json_path
# ---------- end py_2 ----------
panel_9 = Panel(py_2)
server = PythonScript(path=panel_9, file=panel_7, start=start)
# ---------- server: Python ----------
import os
import threading
from scriptcontext import sticky as st

server_address = st["server_address"]
server_port = st["server_port"]
ur_ip1 = st["ur_ip1"]

print file
 
main = os.path.join(path, file.strip())
print main


if os.path.isfile(main):
        
    def myfunc():
        syscall = "C:\Users\Student\Anaconda3\envs\environpy27\python %s %s %s %s" % (main, server_address, server_port, ur_ip1)
        os.system(syscall)
    
    if start:
        t = threading.Thread(target=myfunc)
        t.start()
else:
    
    raise Exception("File does not exist")
# ---------- end server ----------

list_item_9 = ListItem(List=point_4, Index=Slider(3, range=0..20), Wrap=True)

panel_10 = Panel("Get UR connected")
ur = PythonScript(send=start)
# ---------- ur: Python ----------
from scriptcontext import sticky as st
from ur_online_control.ur_driver import URDriver

server_address = st["server_address"]
server_port = st["server_port"]
ur_ip1 = st["ur_ip1"]
robot1 = st["robot1"]

tool_angle_axis = list(robot1.tool.tcp_frame.point) + robot1.tool.tcp_frame.axis_angle_vector
#robot.tool.tcp_frame.pose_axis_angle_vector
print tool_angle_axis

ur_driver = URDriver(server_address, server_port, tool_angle_axis, ur_ip1, "UR")
print ur_driver

if send:
    ur_driver.send()
# ---------- end ur ----------

connect = Button()

panel_11 = Panel("Get Grasshopper connected")
disconnect = Button()
client = PythonScript(connect=connect, disconnect=disconnect)  # -> connected, client; inputs disconnect: Boolean
# ---------- client: Python ----------
import time
from scriptcontext import sticky as st
from Rhino.RhinoApp import WriteLine
from ur_online_control.ghpython import GHClient, gh_component_timer
import time

server_address = st["server_address"]
server_port = st["server_port"]

guid = str(ghenv.Component.InstanceGuid)

client_key = "client_" + guid
run_key = "run_" + guid

if connect:
    if client_key not in st:
        st[client_key] = GHClient(server_address, server_port)
        client = st[client_key]
        client.connect_to_server()
        client.start()
        
    else:
        if st[client_key].running:
            WriteLine("Client is already connected.")
            
        else:
            st[client_key] = GHClient(server_address, server_port)
            client = st[client_key]
            client.connect_to_server()
            client.start()
"""
else:
    if client_key in st:
        # we need a timer to ask if we have something on the rcv queue
        client = st[client_key]
        #if client.running:
        #    #client.run_inner_while()
        #    gh_component_timer(ghenv, True, 1000)
"""

if disconnect:
    #print "disconnecting"
    if client_key in st:
        client = st[client_key]
        if client.running:
            client.close()

if client_key in st:
    connected =  st[client_key].running
    client = st[client_key]
    print st[client_key].rcv_queue.qsize()
    print st[client_key].snd_queue.qsize()
else:
    connected = False
# ---------- end client ----------
panel_12 = Panel(client.connected)

# ---- group: for touble shooting
# Press here to send the commands
# to the robot
continue_fabrication = BooleanToggle(False)
send = Button()
send_2 = PythonScript(client=client.client, send=send, continue_fabrication=continue_fabrication, commands=command_gen.commands)  # -> out, commands; inputs continue_fabrication: Int32, commands: list
# ---------- send_2: Python ----------
import os
import Rhino.Geometry as rg
from scriptcontext import sticky as st
from ur_online_control.communication.msg_identifiers import *
from ur_online_control.utilities.lists import flatten_list
from compas.geometry import Frame, Transformation
from compas_ghpython import xdraw_frame
import json

robot1 = st["robot1"]
tool = robot1.tool
tool_pose = list(tool.tcp_frame.point) + tool.tcp_frame.axis_angle_vector

if "commands_to_execute" not in st:
    st["commands_to_execute"] = 0

commands_flattened = flatten_list(commands)
#safety_commands_flattened = flatten_list(safety_commands)

#print safety_commands_flattened

len_command = len(commands[0])
len_commands = int(len(commands_flattened)/len_command)
print "length of commands: ", len_commands
print "length of command: ", len_command

if send and client:
    # 1. send continue fabrication
    #client.send(MSG_INT, int(continue_fabrication))
    
    # 2. send tool tcp
    client.send(MSG_FLOAT_LIST, tool_pose) # set tool tcp
    
    # 3. send command length
    client.send(MSG_INT, len_command)
    
    # 4. send commands
    client.send(MSG_FLOAT_LIST, commands_flattened)
    
    # 5. send safety commands
#    client.send(MSG_FLOAT_LIST, safety_commands_flattened)
    
    st["commands_to_execute"] = len_commands
    st["current_number"] = 0
# ---------- end send_2 ----------

# ----
# This component updates on receive
bang_2 = Button()
receive = PythonScript(client=client.client, bang=bang_2)  # -> qsize, client
# ---------- receive: Python ----------
from ur_online_control.communication.msg_identifiers import *
from ur_online_control.utilities.lists import flatten_list
from Rhino.RhinoApp import WriteLine

if client:
    if not client.ghenv:
        client.ghenv = ghenv
    qsize = client.rcv_queue.qsize()


print client
# ---------- end receive ----------
panel_13 = Panel(receive.qsize)

# ----
# This is sent after every pose reached
time = Slider(0, range=0..3)
send_3 = PythonScript(client=receive.client, wait_time=time, pause=Toggle(False), continue_loop=Button())  # -> msg, commands_to_execute, pose_joints, bang; inputs pause: Boolean, continue_loop: Boolean
# ---------- send_3: Python ----------
from ur_online_control.communication.msg_identifiers import *
from ur_online_control.utilities.lists import flatten_list
import os
import json
from compas_fab.robots import Configuration

from scriptcontext import sticky as st

guid = str(ghenv.Component.InstanceGuid)
msg_key = "msg_" + guid

path = st["json_path"]
current_number_file = os.path.join(path, "current_number.txt")

if msg_key not in st:
    st[msg_key] = []

if client:
    qsize = client.rcv_queue.qsize()
    if qsize:
        st["commands_to_execute"] -= 1
        st["current_number"] += 1
        # save data into json file
        with open(current_number_file, 'w') as f:
            json.dump({"current_number": st["current_number"]}, f)
        msg = client.rcv_queue.get()
        st[msg_key] = msg
        client.send(MSG_FLOAT_LIST, [wait_time])
        client.send(MSG_INT, int(pause))

if continue_loop:
    client.send(MSG_INT, int(1))
        

msg = st[msg_key]
bang = True
commands_to_execute = st["commands_to_execute"]

if len(msg) == 6:
    pose_joints = Configuration.from_revolute_values(msg)
else:
    pose_joints = Configuration.from_revolute_values([0,0,0,0,0,0])
# ---------- end send_3 ----------
panel_14 = Panel(send_3.msg)
commands_to_execute = Panel(send_3.commands_to_execute)

# ---- group: for touble shooting
ghpython_script_6 = PythonScript(frames_WCS=plane_generation.frames_WCS)  # -> out, planes_WCS; inputs frames_WCS: list
# ---------- ghpython_script_6: Python ----------
import Rhino.Geometry as rg

planes_WCS = []
for frame in frames_WCS:
    origin = rg.Point3d(frame[0][0], frame[0][1], frame[0][2])
    x_vec = rg.Vector3d(frame[1][0], frame[1][1], frame[1][2])
    y_vec = rg.Vector3d(frame[2][0], frame[2][1], frame[2][2])
    planes_WCS.append(rg.Plane(origin, x_vec, y_vec))
# ---------- end ghpython_script_6 ----------
speed = Slider(20, range=0..300)
ghpython_script_7 = PythonScript(frames_WCS=plane_generation.frames_WCS, dfillet=Slider(20, range=0..100), speed=speed)  # -> commands; inputs frames_WCS: list, speed: Int32
# ---------- ghpython_script_7: Python ----------
import Rhino.Geometry as rg
from compas.geometry import Frame
from compas.geometry import Transformation
from compas.geometry import length_vector
from compas_ghpython import xdraw_frame
from scriptcontext import sticky as st

robot1 = st["robot1"]
buffer = 0.7

# TODO this must be optimized! matrix multiplication!
commands = []
for i, frame_WCS in enumerate(frames_WCS):
    tcp_WCS = Frame(frame_WCS[0], frame_WCS[1], frame_WCS[2])
    if i == 0 or i == len(frames_WCS) - 1:
        radius = 0.
        
    else:
        # calculate blend radius
        prev, current, next = frames_WCS[i-1][0], frames_WCS[i][0], frames_WCS[i+1][0]
        #result = map(lambda x: x + x, numbers)
        radius = min(length_vector(map(lambda x, y: x - y, prev, current))/2 * buffer, length_vector(map(lambda x, y: x - y, next, current))/2, dfillet)
        print radius
        #radius = min((prev - current).Length/2 * buffer, (next - current).Length/2 * buffer, dfillet)
    
    tcp_RCS = robot1.get_frame_in_RCS(tcp_WCS)
    
    cmd = list(tcp_RCS.point) + tcp_RCS.axis_angle_vector + [speed, radius]
    #cmd = list(tcp_RCS.point) + tcp_RCS.axis_angle_vector + [time, radius]
    commands.append(cmd)
    
    
    
print (commands)
# ---------- end ghpython_script_7 ----------
plane_6 = Plane(ghpython_script_6.planes_WCS)
polyline = PolyLine(Vertices=plane_6, Closed=False)
point_5 = Point(plane_6)
curve = Curve(polyline)
custom_preview_5 = CustomPreview(Geometry=[curve, point_5], Shader=ColourSwatch(SwatchColor=RGB(255, 94, 94)))
custom_preview_6 = CustomPreview(Geometry=plane_6, Shader=ColourSwatch(SwatchColor=RGB(194, 195, 191)))

# ----
point_6 = Point(<point referenced from the Rhino model>)
curve_2 = Curve(<curve referenced from the Rhino model>)
curve_3 = Curve(<curve referenced from the Rhino model>)
construct_plane = ConstructPlane(Origin=point_6, XAxis=curve_2, YAxis=curve_3)

get = Button()
pose = PythonScript(get=get)  # -> pose_cartesian
# ---------- pose: Python ----------
from scriptcontext import sticky as st
from ur_online_control.ur_direct import get_current_pose_cartesian

server_address = st["server_address"]
server_port = 30005
ur_ip1 = st["ur_ip1"]
robot1 = st["robot1"]
tool_angle_axis = list(robot1.tool.tcp_frame.point) + robot1.tool.tcp_frame.axis_angle_vector
print tool_angle_axis

guid = str(ghenv.Component.InstanceGuid)
pose_cartesian_key = "pose_cartesian" + guid


if get:
    st[pose_cartesian_key] = get_current_pose_cartesian(server_address, server_port, ur_ip1, tool_angle_axis)

if pose_cartesian_key not in st:
    pose_cartesian = []
else:
    pose_cartesian = st[pose_cartesian_key]
# ---------- end pose ----------
# We are not using this,
# only the left part for online communication.
panel_15 = Panel("get pose cartesian")
py_3 = PythonScript(pose_cartesian=pose)  # -> frame_WCS; inputs pose_cartesian: list
# ---------- py_3: Python ----------
import Rhino.Geometry as rg
from scriptcontext import sticky as st
from compas.geometry import Frame
from compas.geometry.xforms import Transformation

robot1 = st["robot1"]

print pose_cartesian
if pose_cartesian:
    #frame_RCS = Frame.from_pose_axis_angle_vector(pose_cartesian)
    frame_RCS = Frame.from_axis_angle_vector(axis_angle_vector=pose_cartesian[3:], point=pose_cartesian[:3])
    frame_WCS = robot1.get_frame_in_WCS(frame_RCS)
    
    print frame_RCS
# ---------- end py_3 ----------
panel_16 = Panel(pose)
draw = Draw(frame=py_3)  # -> G, C
custom_preview_7 = CustomPreview(Geometry=draw.G, Shader=draw.C)

get_2 = Button()
pose_2 = PythonScript(get=get_2, get_init=py.trigger)  # -> pose_joints
# ---------- pose_2: Python ----------
from scriptcontext import sticky as st
from ur_online_control.ur_direct import get_current_pose_joints
from compas_fab.robots import Configuration

server_address = st["server_address"]
server_port = 30005
ur_ip1 = st["ur_ip1"]
robot1 = st["robot1"]
tool_angle_axis = list(robot1.tool.tcp_frame.point) + robot1.tool.tcp_frame.axis_angle_vector
print tool_angle_axis

guid = str(ghenv.Component.InstanceGuid)
pose_joints_key = "pose_joints" + guid


if get or get_init:
    st[pose_joints_key] = get_current_pose_joints(server_address, server_port, ur_ip1, tool_angle_axis)
    
if pose_joints_key not in st:
    pose_joints = Configuration.from_revolute_values([0,0,0,0,0,0])
else:
    pose_joints = Configuration.from_revolute_values(st[pose_joints_key])

print pose_joints
# ---------- end pose_2 ----------
panel_17 = Panel("get pose joint")
panel_18 = Panel(pose_2)

stop = Button()
stop_2 = PythonScript(stop=stop)
# ---------- stop_2: Python ----------
from scriptcontext import sticky as st
from ur_online_control.ur_direct import stop as stop_robot

ur_ip = st["ur_ip"]

if stop:
    stop_robot(ur_ip)
# ---------- end stop_2 ----------

# ----
# Direct UR control
panel_19 = Panel("stop")

# ----
# Calculate basis
# Measure basis:
# 1. Clear the recorded poses
# 2. Move robot to origin and press "get pose"
# 3. Move robot to point in positive x-axis and press "get pose"
# 4. Move robot to an other point in your basis and press "get pose"
# (The further away these positions are, the better)
# 
# 5. Alternatively change the order in the component calc base
# 6. Copy output into base component
value_list_4 = ValueList({"origin, pt on positive x-axis, pt in xy plane": 0, "origin, pt on positive y-axis, pt in xy plane": 1}, selected="origin, pt on positive x-axis, pt in xy plane")
clear = Button()
rec = PythonScript(msg=pose, rec=get, clear=clear)  # -> rec; inputs msg: list
# ---------- rec: Python ----------
from scriptcontext import sticky as st

guid = str(ghenv.Component.InstanceGuid)
recorded_key =  "recorded_" + guid
just_cleared_key = "just_cleared_" + guid


if recorded_key not in st:
    st[recorded_key] = []

if just_cleared_key not in st:
    st[just_cleared_key] = False

if clear:
    st[recorded_key] = []
    st[just_cleared_key] = True
else:
    if len(msg):
        if msg != [None] and not st[just_cleared_key] and rec:
            st[recorded_key].append(msg)
    st[just_cleared_key] = False
        


rec = st[recorded_key]

print rec
# ---------- end rec ----------
calc_base = PythonScript(poses=rec, input_type=value_list_4)  # -> out; inputs poses: list
# ---------- calc_base: Python ----------
import Rhino.Geometry as rg
import math

print poses
if len(poses) > 2:
    
    
    O = poses[0]
    P1 = poses[1]
    P2 = poses[2]
    
    if input_type == 0:
        # origin, pt on positive x-axis, pt in xy plane
        origin = rg.Point3d(O[0], O[1], O[2])
        pt_on_xaxis = rg.Point3d(P1[0], P1[1], P1[2])
        pt_in_xyplane = rg.Point3d(P2[0], P2[1], P2[2])
        
        xaxis = pt_on_xaxis - origin
        xaxis.Unitize()
        
        v = pt_in_xyplane - origin
        zaxis = rg.Vector3d.CrossProduct(v, xaxis)
        zaxis.Unitize()
        
        # zaxis must look up!
        if math.acos(rg.Vector3d.ZAxis * zaxis) > math.acos(rg.Vector3d.ZAxis * -zaxis):
            zaxis = -zaxis
        
        yaxis = rg.Vector3d.CrossProduct(zaxis, xaxis)
    
    elif input_type == 1:
        # origin, pt on positive y-axis, pt in xy plane
        origin = rg.Point3d(O[0], O[1], O[2])
        pt_on_yaxis = rg.Point3d(P1[0], P1[1], P1[2])
        pt_in_xyplane = rg.Point3d(P2[0], P2[1], P2[2])
        
        yaxis = pt_on_yaxis - origin
        yaxis.Unitize()
        
        v = pt_in_xyplane - origin
        zaxis = rg.Vector3d.CrossProduct(v, yaxis)
        zaxis.Unitize()
        
        # zaxis must look up!
        if math.acos(rg.Vector3d.ZAxis * zaxis) > math.acos(rg.Vector3d.ZAxis * -zaxis):
            zaxis = -zaxis
        
        xaxis = rg.Vector3d.CrossProduct(yaxis, zaxis)
        
        
    print "Copy the following into base component:"
    print " "
    print "origin = [%.2f, %.2f, %.2f]" % tuple(list(origin))
    print "xaxis = [%.5f, %.5f, %.5f]" % tuple(list(xaxis))
    print "yaxis = [%.5f, %.5f, %.5f]" % tuple(list(yaxis))
    

#print rg.Vector3d.CrossProduct(rg.Vector3d.YAxis, rg.Vector3d.ZAxis)
#print rg.Vector3d.CrossProduct(rg.Vector3d.ZAxis, rg.Vector3d.XAxis)
# ---------- end calc_base ----------
panel_20 = Panel(rec)
panel_21 = Panel(calc_base)

# ---- group: Define joint positions
base_3 = Slider(-329.599, range=-360..360)
elbow = Slider(-111.454, range=-360..360)
wrist2 = Slider(-82.725, range=-360..360)
wrist3 = Slider(91.571, range=-360..360)
shoulder = Slider(-49.479, range=-360..360)
wrist1 = Slider(-190.504, range=-360..360)
ur1_q1_q6 = Data([base_3, shoulder, elbow, wrist1, wrist2, wrist3])

# ----
# Visualisation
planes_wcs = Plane(plane_6)
pose_joints = Data(pose_2)
robot_2 = Data(set_params)
back = Button()
reset = Button()
py_4 = GhPythonScript(joint_values=ur1_q1_q6)  # -> configuration; inputs joint_values: list
# ---------- py_4: Python ----------
import math
from compas_fab.robots import Configuration

configuration = Configuration.from_revolute_values([math.radians(d) for d in joint_values])
# ---------- end py_4 ----------

# ---- group: Define plane in WCS, calculate joint positions
point_7 = Point(Point(-57.48867812, -568.9400192, 535.0971902))
xy_plane = XYPlane(Origin=point_7)
deconstruct_plane = DeconstructPlane(Plane=xy_plane)  # -> Origin, XAxis, YAxis, ZAxis
multiplication = Multiplication(A=deconstruct_plane.XAxis, B=-1)
construct_plane_2 = ConstructPlane(Origin=deconstruct_plane.Origin, XAxis=multiplication, YAxis=deconstruct_plane.YAxis)
select_configuration = Slider(0, range=0..7)
plane_wcs = Plane(construct_plane)
inverse = PythonScript(robot1=robot_2, plane_WCS=plane_wcs, idx=select_configuration)  # -> configuration, plane_WCS; inputs plane_WCS: Plane, idx: Int32
# ---------- inverse: Python ----------
import Rhino.Geometry as rg
from compas.geometry import Frame, Transformation
from compas_ghpython import xdraw_frame
import math


#plane_WCS.Rotate(math.radians(-10), plane_WCS.YAxis, plane_WCS.Origin)
#plane_WCS.Rotate(math.radians(-10), plane_WCS.ZAxis, plane_WCS.Origin)

plane_WCS.Rotate(math.radians(90), plane_WCS.ZAxis, plane_WCS.Origin)

tcp_WCS = Frame(plane_WCS.Origin, plane_WCS.XAxis, plane_WCS.YAxis)
#print tcp_WCS

# transform frame to robot1 coordinate system
#tool_plane_in_RCS = self.get_tool_plane_in_RCS(tp_WCS)
tcp_RCS = robot1.get_frame_in_RCS(tcp_WCS)

tool0_RCS = robot1.get_tool0_frame_from_tcp_frame(tcp_RCS)

# calculate solutions to frame
solutions = robot1.inverse_kinematics(tool0_RCS)

if not len(solutions):
    q = [0,0,0,0,0,0]
else:
    idx = min(len(solutions) - 1, idx)
    q = solutions[idx]
    
#print q

configuration = q
print configuration
# ---------- end inverse ----------

# ---- group: Calculate joint positions for path
# Add init joint states
joint_states = Data([-0.1728179112, -1.415058186, 1.813991282, -1.971940356, -1.571654205, -3.308720436])
init_configuration = Slider(2, range=0..7)
py_5 = PythonScript(robot1=robot_2, planes_WCS=planes_wcs, configuration_idx=init_configuration, init_configuration=joint_states)  # -> configurations; inputs planes_WCS: list, configuration_idx: Int32, init_configuration: list
# ---------- py_5: Python ----------
from compas_ghpython import unload_modules
unload_modules('ur_online_control')
import Rhino.Geometry as rg
from compas.geometry import Frame 
from compas.geometry.xforms import Transformation
from compas_ghpython import xdraw_frame
from ur_online_control.ur.kinematics import calculate_configurations_for_path, format_joint_positions


# TODO this must be optimized! matrix multiplication!
frames_tool0_RCS = []
for plane_WCS in planes_WCS:
    tcp_WCS = Frame(plane_WCS.Origin, plane_WCS.XAxis, plane_WCS.YAxis)
    tcp_RCS = robot1.get_frame_in_RCS(tcp_WCS)
    frames_tool0_RCS.append(robot1.get_tool0_frame_from_tcp_frame(tcp_RCS))
    

#configurations = calculate_configurations_for_path(frames_tool0_RCS, robot1.params, init_configuration)
configurations = calculate_configurations_for_path(frames_tool0_RCS, robot1, init_configuration)
#print configurations
configurations = configurations[min([configuration_idx, len(configurations) - 1])]

def format(numbers, k=4):
    #numbers = format_joint_positions(numbers)
    return "[" + ", ".join([("%." + str(k) + "f") % n for n in numbers]) + "]"
# ---------- end py_5 ----------
start_2 = Button()
step = Button()
stop_3 = Button()
counter = CountThroughList(L=py_5, start=start_2, stop=stop_3, step=step, step_back=back, reset=reset, interval=100)  # -> item; inputs L: list, start: Boolean, stop: Boolean, step_back: Boolean
# ---------- counter: Python ----------
from scriptcontext import sticky as st
from compas_ghpython import update_component


# store data in component
guid = str(ghenv.Component.InstanceGuid)
counter_key = "counter_" + guid
running_key = "running_" + guid

if counter_key not in st:
    st[counter_key] = 0

if running_key not in st:
    st[running_key] = False

if start:
    st[running_key] = True

if stop:
    st[running_key] = False

if step:
    if st[counter_key] < len(L) - 1:
        st[counter_key] += 1

if step_back:
    if st[counter_key] < len(L) - 1:
        st[counter_key] -= 1

if reset:
    st[counter_key] = 0

if len(L):
    item = L[st[counter_key]]

if st[running_key]:
    if st[counter_key] < len(L) - 1:
        st[counter_key] += 1
        update_component(ghenv, interval)
    else:
        st[counter_key] = 0
        st[running_key] = False
# ---------- end counter ----------

# ---- group: Calculate joint positions for path / Shows joint positions along path
flip = BooleanToggle(True)
l2t = PythonScript(L=py_5, flip=flip)  # -> T; inputs L: list, flip: Boolean
# ---------- l2t: Python ----------
from compas_ghpython import list_to_ghtree
L = [l.values for l in L]

if flip:
    L = zip(*L)
T = list_to_ghtree(L)
# ---------- end l2t ----------
quick_graph = QuickGraph(l2t, SortOrder=0)

# ----
ur10_brep = UR10Brep([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])

# ---- group: Visualise / robot model brep
py_6 = PythonScript(model=value_list_3)  # -> n
# ---------- py_6: Python ----------
if model == "UR5":
    n = 0
if model == "UR10":
    n = 1
if model == "UR3":
    n = 2


#n = 2 
print n
# ---------- end py_6 ----------
ur10_brep_2 = UR10Brep([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])
ur5_brep = UR5Brep([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])
show_brep = BooleanToggle(True)
stream_filter = StreamFilter(Gate=py_6, Stream0=ur5_brep, Stream1=ur10_brep_2, Stream2=ur10_brep)

# ---- group: Visualise
# Choose from different options, which robot configuration to visualise
value_list_5 = ValueList({"0 forward, from angles": 0, "1 inverse, from one plane": 1, "2 inverse, from multiple planes": 2, "3 forward, from robot": 3, "4 forward, from robot during runtime": 4}, selected="2 inverse, from multiple planes")
stream_filter_2 = StreamFilter(
    Gate=value_list_5,
    Stream0=py_4,
    Stream1=inverse.configuration,
    Stream2=counter,
    Stream3=pose_joints,
    Stream4=send_3.pose_joints)
draw_2 = PythonScript(robot1=robot_2, configuration=stream_filter_2, mesh=stream_filter, brep=stream_filter, show_brep=show_brep)  # -> meshes, tool0_plane, tcp_plane, robot_brep, list_degree; inputs mesh: list, brep: list, show_brep: Boolean
# ---------- draw_2: Python ----------
from compas_ghpython import unload_modules
unload_modules("ur_online_control")

from compas_ghpython import xdraw_frame
from compas_ghpython import mesh_draw
from compas_ghpython.geometry.xforms import xform_from_transformation
from compas.geometry import Frame
from compas.geometry.xforms import Transformation
from compas_fab.robots import Configuration

import Rhino.Geometry as rg
import Rhino
import math

def mesh_update_vertices(mesh, vertices):
    for i in range(len(vertices)):
        mesh.vertex[i].update({'x': vertices[i][0], 'y': vertices[i][1], 'z': vertices[i][2]})

if configuration:
    list_joint_values = configuration.data["values"]
    list_degree = []
    for degree in list_joint_values:
        degree = math.degrees(degree)
        list_degree.append(degree)
    print list_degree
    #q = BaseConfiguration.from_joints(configuration)
    q = configuration
    print q
    #print q.joint_values
    
    #print robot1.get_forward_transformations(q)
    R0, R1, R2, R3, R4, R5 = robot1.get_forward_transformations(q)
    
    tool0_frame2 = robot1.tool0_frame.transformed(R5)
    tcp_frame2 = Frame.from_transformation(Transformation.from_frame(tool0_frame2) * robot1.transformation_tool0_tcp)
    
    #print robot1.transformation_tool0_tcp
    #print robot1.transformation_tcp_tool0
    #print robot1.transformation_tool0_tcp * robot1.transformation_tcp_tool0
    #print tcp_frame2
    tcp_frame2 = Frame.from_transformation(Transformation.from_frame(tool0_frame2) * robot1.transformation_tcp_tool0)
    #print tcp_frame2
    
    tool0_frame, tcp_frame = robot1.get_transformed_tool_frames(R5)
    
    tool0_frame = tool0_frame2
    tcp_frame = tcp_frame2
    
    m0, m1, m2, m3, m4, m5 = mesh
    for i in range(6):
        exec("R%drg = xform_from_transformation(R%d)" % (i, i))
        exec("m%d.Transform(R%drg)" % (i, i))
    meshes = [m0, m1, m2, m3, m4, m5]
    #print meshes
    mt = robot1.tool.get_transformed_model(Transformation.from_frame(tool0_frame))
    
    if mt:
        meshes.extend(map(mesh_draw, mt))
    
    """
    m0, m1, m2, m3, m4, m5, tool0_frame, tcp_frame = robot1.get_transformed_model(q)
    mt = robot1.get_transformed_tool_model(tcp_frame)
    
    meshes = []
    meshes.append(mesh_draw(m0))
    meshes.append(mesh_draw(m1))
    meshes.append(mesh_draw(m2))
    meshes.append(mesh_draw(m3))
    meshes.append(mesh_draw(m4))
    meshes.append(mesh_draw(m5))
    if mt:
        meshes.append(mesh_draw(mt))
    
    """
    
    tool0_plane = xdraw_frame(tool0_frame)
    tcp_plane = xdraw_frame(tcp_frame)
    
    if show_brep:
        
        b0, b1, b2, b3, b4, b5 = brep
        
        b0.Transform(R0rg)
        b1.Transform(R1rg)
        b2.Transform(R2rg)
        b3.Transform(R3rg)
        b4.Transform(R4rg)
        b5.Transform(R5rg)
        
        robot_brep = [b0, b1, b2, b3, b4, b5]
        print robot_brep

#print brep
# ---------- end draw_2 ----------
robot_brep = Brep(draw_2.robot_brep)
tool0_plane = Plane(draw_2.tool0_plane)
tcp_plane = Plane(draw_2.tcp_plane)
mesh = Mesh(draw_2.meshes)
custom_preview_8 = CustomPreview(Geometry=mesh, Shader=ColourSwatch(SwatchColor=RGBA(0, 255, 229, 119)))
draw_3 = RepresentPlaneAsLines(plane=[tcp_plane, tool0_plane], size=100)  # -> G, C
# ---------- draw_3: Python ----------
import Rhino.Geometry as rg
from System.Drawing import Color

if plane:

    G = []
    G.append(rg.Line(plane.Origin, size * plane.XAxis))
    G.append(rg.Line(plane.Origin, size * plane.YAxis))
    G.append(rg.Line(plane.Origin, size * plane.ZAxis))
    
    C = []
    C.append(Color.FromArgb(255, 0, 0))
    C.append(Color.FromArgb(0, 255, 0))
    C.append(Color.FromArgb(0, 0, 255))
# ---------- end draw_3 ----------
custom_preview_9 = CustomPreview(Geometry=draw_3.G, Shader=draw_3.C)

# ----
idx = Slider(0, range=0..100)
panel_22 = Panel("move joints")
value_list_6 = ValueList({"send all positions": 0, "send only one position": 1}, selected="send only one position")
joint_configurations = Data(stream_filter_2)
list_item_10 = ListItem(List=joint_configurations, Index=idx, Wrap=True)
stream_filter_3 = StreamFilter(Gate=value_list_6, Stream0=joint_configurations, Stream1=list_item_10)
movej = PythonScript(joint_configurations=stream_filter_3, velocity=Slider(100, range=0..200))  # -> script; inputs joint_configurations: list
# ---------- movej: Python ----------
script_lines = []


for configuration in joint_configurations:
    #print configuration.joint_values
    script_lines.append("movej(%s, v=%f)" % (str(configuration.values), velocity/1000.))


script = "def prog():\n"
script += "\ttextmsg(\">> program start\")\n"
script += "".join(["\t%s\n" % line for line in script_lines])
script += "\ttextmsg(\"<< program end\")\n"
script += "end\n"
script += "prog()\n\n"


print script

#script = ""
# ---------- end movej ----------
send_4 = Button()
send_5 = Send(script=movej, send=send_4)
panel_23 = Panel(send_5)

number = Slider(0, range=0..10)
panel_24 = Panel("set digital out")
value = BooleanToggle(False)
digital_out = PythonScript(number=number, value=value)  # -> script; inputs number: Int32, value: Boolean
# ---------- digital_out: Python ----------
script = "def prog():\n"
script += "\ttextmsg(\">> program start\")\n"
script += "\tset_digital_out(%i, %s)\n" % (int(number), str(value))
script += "\ttextmsg(\"<< program end\")\n"
script += "end\n"
script += "prog()\n\n"

print script
# ---------- end digital_out ----------
send_6 = Button()
send_7 = Send(script=digital_out, send=send_6)
panel_25 = Panel(send_7)

panel_26 = Panel("move cartesian")
idx_2 = Slider(0, range=0..100)
value_list_7 = ValueList({"send all positions": 0, "send only one position": 1}, selected="send all positions")
commands = Data(send_2.commands)
list_item_11 = ListItem(List=commands, Index=idx_2, Wrap=True)
stream_filter_4 = StreamFilter(Gate=value_list_7, Stream0=commands, Stream1=list_item_11)
movel = PythonScript(commands=stream_filter_4)  # -> script; inputs commands: list
# ---------- movel: Python ----------
from scriptcontext import sticky as st

script_lines = []
for cmd in commands:
    #q, a=1.4, v=1.05, t=0, r=0)
    x, y, z, ax, ay, az, speed, radius = cmd
    script_lines.append("movel(p%s, v=%f, r=%f)" % (str([x/1000., y/1000., z/1000, ax, ay, az]), speed/1000., radius/1000.))

robot = st["robot"]
tool_angle_axis = list(robot.tool.tcp_frame.point) + robot.tool.tcp_frame.axis_angle_vector
x, y, z, ax, ay, az = tool_angle_axis

script = "def prog():\n"
script += "\ttextmsg(\">> program start\")\n"
script += "\tset_tcp(p%s)\n" % str([x/1000., y/1000., z/1000, ax, ay, az])
script += "".join(["\t%s\n" % line for line in script_lines])
script += "\ttextmsg(\"<< program end\")\n"
script += "end\n"
script += "prog()\n\n"

print script
# ---------- end movel ----------
send_8 = Button()
send_9 = Send(script=movel, send=send_8)
panel_27 = Panel(send_9)

panel_28 = Panel(draw_2.list_degree)

# ----
# move incremental in WCS
number_slider_9 = Slider(5, range=-10..10)
value_list_8 = ValueList({"xaxis", "yaxis", "zaxis"}, selected="zaxis")
movel_2 = PythonScript(step_size=number_slider_9, direction=value_list_8)  # -> script
# ---------- movel_2: Python ----------
from scriptcontext import sticky as st

robot = st["robot"]
tool_angle_axis = list(robot.tool.tcp_frame.point) + robot.tool.tcp_frame.axis_angle_vector
x, y, z, ax, ay, az = tool_angle_axis

script = "def prog():\n"
script += "\ttextmsg(\">> program start\")\n"
script += "\tset_tcp(p%s)\n" % str([x/1000., y/1000., z/1000, ax, ay, az])
script += "\tcurrent_pose = get_forward_kin()\n"


if direction == "xaxis":
    script += "\tmovel(p[current_pose[0] + %f, current_pose[1], current_pose[2], current_pose[3], current_pose[4], current_pose[5]], t=%f)\n" % (step_size/1000., step_size * 0.1)

elif direction == "yaxis":
    script += "\tmovel(p[current_pose[0], current_pose[1] + %f, current_pose[2], current_pose[3], current_pose[4], current_pose[5]], t=%f)\n" % (step_size/1000., step_size * 0.1)

else: # direction == "zaxis":
    script += "\tmovel(p[current_pose[0], current_pose[1], current_pose[2] + %f, current_pose[3], current_pose[4], current_pose[5]], t=%f)\n" % (step_size/1000., step_size * 0.1)

script += "\ttextmsg(\"<< program end\")\n"
script += "end\n"
script += "prog()\n\n"

print script
# ---------- end movel_2 ----------
send_10 = Button()
send_11 = Send(script=movel_2, send=send_10)
panel_29 = Panel(send_11)

panel_30 = Panel("reorient tool vertical")
movel_3 = PythonScript()  # -> script
# ---------- movel_3: Python ----------
from scriptcontext import sticky as st

robot = st["robot"]
tool_angle_axis = list(robot.tool.tcp_frame.point) + robot.tool.tcp_frame.axis_angle_vector
x, y, z, ax, ay, az = tool_angle_axis

script = "def prog():\n"
script += "\ttextmsg(\">> program start\")\n"
script += "\tset_tcp(p%s)\n" % str([x/1000., y/1000., z/1000, ax, ay, az])
script += "\tcurrent_pose = get_forward_kin()\n"
script += "\tmovel(p[current_pose[0], current_pose[1], current_pose[2], 0, 0, 0], a=0.1, v=0.1)\n"
script += "\ttextmsg(\"<< program end\")\n"
script += "end\n"
script += "prog()\n\n"

print script
# ---------- end movel_3 ----------
send_12 = Button()
send_13 = Send(script=movel_3, send=send_12)
panel_31 = Panel(send_13)

# ----
# move incremental in TCS
number_slider_10 = Slider(5, range=-10..10)
value_list_9 = ValueList({"xaxis", "yaxis", "zaxis"}, selected="yaxis")
get_current_pose = Button()
movel_4 = PythonScript(get=get_current_pose, step_size=number_slider_10, direction=value_list_9)  # -> script; inputs get: list
# ---------- movel_4: Python ----------
from scriptcontext import sticky as st
from compas.geometry import Frame
from compas.geometry import Point, Vector
from ur_online_control.ur_direct import get_current_pose_cartesian

server_address = st["server_address"]
server_port = 30005
ur_ip = st["ur_ip"]
robot = st["robot"]
tool_angle_axis = list(robot.tool.tcp_frame.point) + robot.tool.tcp_frame.axis_angle_vector
print tool_angle_axis

guid = str(ghenv.Component.InstanceGuid)
pose_cartesian_key = "pose_cartesian" + guid

if get:
    st[pose_cartesian_key] = get_current_pose_cartesian(server_address, server_port, ur_ip, tool_angle_axis)

if pose_cartesian_key not in st:
    pose_cartesian = []
    script = ""
else:
    pose_cartesian = st[pose_cartesian_key]

    robot = st["robot"]
    tool_angle_axis = list(robot.tool.tcp_frame.point) + robot.tool.tcp_frame.axis_angle_vector
    x, y, z, ax, ay, az = tool_angle_axis
    
    script = "def prog():\n"
    script += "\ttextmsg(\">> program start\")\n"
    script += "\tset_tcp(p%s)\n" % str([x/1000., y/1000., z/1000, ax, ay, az])
    script += "\tcurrent_pose = get_forward_kin()\n"
    
#    frame = Frame.from_pose_axis_angle_vector(pose_cartesian)
    frame = Frame.from_axis_angle_vector([ax, ay, az])
    frame.point = [x, y, z]

    if direction == "xaxis":
        next_vector = Vector(*frame.xaxis) * step_size
    elif direction == "yaxis":
        next_vector = Vector(*frame.yaxis) * step_size
    else: # direction == "zaxis":
        next_vector = Vector(*frame.zaxis) * step_size
    
    x, y, z = next_vector
    script += "\tmovel(p[current_pose[0] + %f, current_pose[1] + %f, current_pose[2] + %f, current_pose[3], current_pose[4], current_pose[5]], t=%f)\n" % (x/1000., y/1000., z/1000., step_size * 0.1)
    
    script += "\ttextmsg(\"<< program end\")\n"
    script += "end\n"
    script += "prog()\n\n"
    
    print script
# ---------- end movel_4 ----------
send_14 = Button()
send_15 = Send(script=movel_4, send=send_14)
panel_32 = Panel(send_15)

# ==== cluster Send
script = ClusterInput()
send = ClusterInput()
send_2 = PythonScript(script=script, send=send)  # -> out
# ---------- send_2: Python ----------
import socket
from scriptcontext import sticky as st

ur_ip = st["ur_ip"]
ur_port = 30002

if send:
    s = socket.create_connection((ur_ip, ur_port), timeout=0.5) 
    s.send(script)
    s.close()
# ---------- end send_2 ----------
out = ClusterOutput(send_2)

# ==== cluster Draw
frame = ClusterInput()
size = ClusterInput()
draw = PythonScript(frame=frame, size=size)  # -> G, C
# ---------- draw: Python ----------
import Rhino.Geometry as rg
from System.Drawing import Color

if not size:
    size = 100

if frame:
    
    plane = rg.Plane(rg.Point3d(*list(frame.point)), rg.Vector3d(*list(frame.xaxis)), rg.Vector3d(*list(frame.yaxis)))

    G = []
    G.append(rg.Line(plane.Origin, size * plane.XAxis))
    G.append(rg.Line(plane.Origin, size * plane.YAxis))
    G.append(rg.Line(plane.Origin, size * plane.ZAxis))
    
    C = []
    C.append(Color.FromArgb(255, 0, 0))
    C.append(Color.FromArgb(0, 255, 0))
    C.append(Color.FromArgb(0, 0, 255))
# ---------- end draw ----------
G = ClusterOutput(draw.G)
C = ClusterOutput(draw.C)

# ==== cluster Tools

# ---- group: arch_2019july_tool3A
geo = Geometry([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])
mesh = Mesh(geo)
brep = Brep(geo)
mjoin = MeshJoin(Meshes=mesh)
xaxis_line = Curve(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)
yaxis_line = Curve(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)
tool = PythonScript(meshes=mjoin, breps=brep, xline=xaxis_line, yline=yaxis_line)  # -> tool; inputs meshes: list of Mesh, breps: list of Brep
# ---------- tool: Python ----------
import Rhino.Geometry as rg
from compas.geometry import Frame
from ur_online_control.ur.tool import Tool
from compas.datastructures import Mesh
from compas_rhino.helpers import mesh_from_guid

xaxis = rg.Line(xline.PointAtStart, xline.PointAtEnd)
yaxis = rg.Line(yline.PointAtStart, yline.PointAtEnd)

if xaxis.From.DistanceTo(yaxis.From) < 0.01:
    origin = xaxis.From
    xaxis = xaxis.Direction
    yaxis = yaxis.Direction
elif xaxis.To.DistanceTo(yaxis.To) < 0.01:
    origin = xaxis.To
    xaxis = -xaxis.Direction
    yaxis = -yaxis.Direction
elif xaxis.From.DistanceTo(yaxis.To) < 0.01:
    origin = xaxis.From
    xaxis = xaxis.Direction
    yaxis = -yaxis.Direction
elif xaxis.To.DistanceTo(yaxis.From) < 0.01:
    origin = xaxis.To
    xaxis = -xaxis.Direction
    yaxis = yaxis.Direction

xaxis.Unitize()
yaxis.Unitize()

print origin
print xaxis
print yaxis

tcp_frame = Frame(origin, xaxis, yaxis)

tool = Tool(tcp_frame)
tool.model = [mesh_from_guid(Mesh, mesh) for mesh in meshes]
#tool.model_xyz = tool.model.xyz
tool.breps = breps
# ---------- end tool ----------

# ---- group: arch_2019july_tool3B
geo_2 = Geometry([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])
mesh_2 = Mesh(geo_2)
brep_2 = Brep(geo_2)
mjoin_2 = MeshJoin(Meshes=mesh_2)
xaxis_line_2 = Curve(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)
yaxis_line_2 = Curve(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)
tool_2 = PythonScript(meshes=mjoin_2, breps=brep_2, xline=xaxis_line_2, yline=yaxis_line_2)  # -> tool; inputs meshes: list of Mesh, breps: list of Brep; same code as tool

# ---- group: sand deposition tool
geo_3 = Geometry([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])
mesh_3 = Mesh(geo_3)
brep_3 = Brep(geo_3)
mjoin_3 = MeshJoin(Meshes=mesh_3)
yaxis_line_3 = Curve(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)
xaxis_line_3 = Curve(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)
tool_3 = PythonScript(meshes=mjoin_3, breps=brep_3, xline=xaxis_line_3, yline=yaxis_line_3)  # -> tool; inputs meshes: list of Mesh, breps: list of Brep; same code as tool

# ---- group: earth deposition tool
geo_4 = Geometry([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])
brep_4 = Brep(geo_4)
mesh_4 = Mesh(geo_4)
mjoin_4 = MeshJoin(Meshes=mesh_4)
yaxis_line_4 = Curve(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)
xaxis_line_4 = Curve(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)
tool_4 = PythonScript(meshes=mjoin_4, breps=brep_4, xline=xaxis_line_4, yline=yaxis_line_4)  # -> tool; inputs meshes: list of Mesh, breps: list of Brep; same code as tool

# ---- group: vault_test2_A
geo_5 = Geometry([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])
mesh_5 = Mesh(geo_5)
brep_5 = Brep(geo_5)
mjoin_5 = MeshJoin(Meshes=mesh_5)
xaxis_line_5 = Curve(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)
yaxis_line_5 = Curve(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)
tool_5 = PythonScript(meshes=mjoin_5, breps=brep_5, xline=xaxis_line_5, yline=yaxis_line_5)  # -> tool; inputs meshes: list of Mesh, breps: list of Brep; same code as tool

# ---- group: vault_test2_B
geo_6 = Geometry([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])
mesh_6 = Mesh(geo_6)
brep_6 = Brep(geo_6)
mjoin_6 = MeshJoin(Meshes=mesh_6)
xaxis_line_6 = Curve(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)
yaxis_line_6 = Curve(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)
tool_6 = PythonScript(meshes=mjoin_6, breps=brep_6, xline=xaxis_line_6, yline=yaxis_line_6)  # -> tool; inputs meshes: list of Mesh, breps: list of Brep; same code as tool

# ---- group: clay subtraction tool
geo_7 = Geometry([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])
brep_7 = Brep(geo_7)
mesh_7 = Mesh(geo_7)
mjoin_7 = MeshJoin(Meshes=mesh_7)
xaxis_line_7 = Curve(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)
yaxis_line_7 = Curve(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)
tool_7 = PythonScript(meshes=mjoin_7, breps=brep_7, xline=xaxis_line_7, yline=yaxis_line_7)  # -> tool; inputs meshes: list of Mesh, breps: list of Brep; same code as tool

# ---- group: pack tool
geo_8 = Geometry([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])
mesh_8 = Mesh(geo_8)
brep_8 = Brep(geo_8)
mjoin_8 = MeshJoin(Meshes=mesh_8)
yaxis_line_8 = Curve(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)
xaxis_line_8 = Curve(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)
tool_8 = PythonScript(meshes=mjoin_8, breps=brep_8, xline=xaxis_line_8, yline=yaxis_line_8)  # -> tool; inputs meshes: list of Mesh, breps: list of Brep; same code as tool

# ---- group: vault_test2_Measure
geo_9 = Geometry([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])
mesh_9 = Mesh(geo_9)
brep_9 = Brep(geo_9)
mjoin_9 = MeshJoin(Meshes=mesh_9)
xaxis_line_9 = Curve(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)
yaxis_line_9 = Curve(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)
tool_9 = PythonScript(meshes=mjoin_9, breps=brep_9, xline=xaxis_line_6, yline=yaxis_line_6)  # -> tool; inputs meshes: list of Mesh, breps: list of Brep; same code as tool

# ----
tool_id = ClusterInput()
tool_id_2 = Integer(tool_id)

# ---- group: measurement tool
geo_10 = Geometry([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])
mesh_10 = Mesh(geo_10)
mjoin_10 = MeshJoin(Meshes=mesh_10)

# ----
brep_10 = Brep(geo_10)

# ---- group: measurement tool (continued)
tool_10 = PythonScript(meshes=mjoin_10, brep=brep_10)  # -> tool; inputs meshes: list, brep: list
# ---------- tool_10: Python ----------
from ur_online_control.ur.tools import MeasurementTool
from compas.datastructures import Mesh
from compas_rhino.helpers import mesh_from_guid


tool = MeasurementTool()
tool.model = [mesh_from_guid(Mesh, mesh) for mesh in meshes]
#tool.model_xyz = tool.model.xyz
tool.brep = brep
# ---------- end tool_10 ----------

# ----
filter = StreamFilter(
    Gate=tool_id_2,
    Stream1=tool_10,
    Stream2=tool_3,
    Stream3=tool_4,
    Stream4=tool_7,
    Stream5=tool_8,
    Stream6=tool,
    Stream7=tool_2,
    Stream8=tool_5,
    Stream9=tool_6,
    Stream10=tool_9)
py = PythonScript(tool=filter)  # -> tcp_frame, model
# ---------- py: Python ----------
from compas_ghpython import mesh_draw 

if tool:
    tcp_frame = tool.tcp_frame
    model = map(mesh_draw, tool.model)
# ---------- end py ----------
tool_11 = Data(filter)
draw = PythonScript(frame=py.tcp_frame)  # -> G, C
# ---------- draw: Python ----------
import Rhino.Geometry as rg
from System.Drawing import Color

if not size:
    size = 100

if frame:
    plane = rg.Plane(rg.Point3d(*list(frame.point)), rg.Vector3d(*list(frame.xaxis)), rg.Vector3d(*list(frame.yaxis)))

    G = []
    G.append(rg.Line(plane.Origin, size * plane.XAxis))
    G.append(rg.Line(plane.Origin, size * plane.YAxis))
    G.append(rg.Line(plane.Origin, size * plane.ZAxis))
    
    C = []
    C.append(Color.FromArgb(255, 0, 0))
    C.append(Color.FromArgb(0, 255, 0))
    C.append(Color.FromArgb(0, 0, 255))
# ---------- end draw ----------
tool_12 = ClusterOutput(tool_11)
preview = CustomPreview(Geometry=py.model, Shader=ColourSwatch(SwatchColor=RGBA(141, 170, 178, 150)))
preview_2 = CustomPreview(Geometry=draw.G, Shader=draw.C)
